# Grasshopper definition unnamed.gh (Grasshopper 1.0.7)

# ---- group: 颜色定义
int = Integer(5)
circle = Circle({Plane=PlaneXY(-0.3105112237, 0.1478948398, 0), Radius=3.196974306})
pt = Point()
field = Field(circle)
panel = Panel("橘黄色，未赋予值")
panel_2 = Panel("深灰色，指定数值")
panel_3 = Panel("白色，赋予模型给变量")
panel_4 = Panel("红色，赋予错误的类型给变量")

# ----
crv = Curve(<curve referenced from the Rhino model>)
divide = DivideCurve(Curve=crv, Count=Slider(28, range=0..100), Kinks=False)  # -> Points, Tangents, Parameters

# ---- group: 作为倍数控制求半径
num = Number(0.1)
addition = Addition(A=divide.Parameters, B=num)
multiplication = Multiplication(A=addition, B=Slider(0.02, range=0..1))

# ---- group: 点转化成坐标平面
pt_2 = Point(divide.Points)
xy = XYPlane(Origin=pt_2)

# ----
sph = Sphere(Base=xy, Radius=multiplication)
